# Grasshopper definition Tapeworm2.0.gh (Grasshopper 1.0.7)

# ---- group: STARTFRAME
path = FilePath("C:\Users\Antoine\source\repos\Tapeworm2\src\components\start_frame_component.py")
file = ReadFile(File=path, PerLineParse=False)
python = GhPythonScript(Code=file, S=Slider(58, range=0..100))  # -> Out, TwS

# ---- group: FRAMERATE
path_2 = FilePath("C:\Users\Antoine\source\repos\Tapeworm2\src\components\framerate_component.py")
file_2 = ReadFile(File=path_2, PerLineParse=False)
python_2 = GhPythonScript(Code=file_2, TwS=python.TwS, F=Slider(85, range=0..100))  # -> Out, TwS

# ----
panel = Panel(python_2.TwS)

# ---- group: Input
path_3 = FilePath("C:\Users\Antoine\Desktop\DELETEME\DUMP\")
path_4 = FilePath("C:\Users\Antoine\source\repos\Tapeworm2\src\components\input_component.py")
file_3 = ReadFile(File=path_4, PerLineParse=False)
python_3 = GhPythonScript(Code=file_3, TwS=python_2.TwS, F=path_3)

# ----
panel_2 = Panel(python_3)

path_5 = FilePath("C:\Users\Antoine\source\repos\Tapeworm2\src\components\output_component.py")
file_4 = ReadFile(File=path_5, PerLineParse=False)
python_4 = GhPythonScript(Code=file_4, TwS=python_3, O="D:\world.mp4")

panel_3 = Panel(python_4)

path_6 = FilePath("C:\Users\Antoine\source\repos\Tapeworm2\src\components\ffmpeg_component.py")
file_5 = ReadFile(File=path_6, PerLineParse=False)
python_5 = GhPythonScript(Code=file_5, TwS=python_4, R=Button())

frames_gif = FramesToGIF()  # -> Settings; plug-in component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
frames_video = FramesToVideo()  # -> Settings; plug-in component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
vidgif_frames = VidGIFToFrames()  # -> Settings; plug-in component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
gif_video = GIFToVideo()  # -> Settings; plug-in component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
frames_frames = FramesToFrames()  # -> Settings; plug-in component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
video_gif = VideoToGIF()  # -> Settings; plug-in component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
